# Grasshopper definition A_MultipleSectionDimensions.ghx (Grasshopper 1.0.7)
# plug-ins: Grasshopper-Tekla drawing Link 2.25, Grasshopper-Tekla Link 2021.1.21

active_drawing = ActiveDrawing(Toggle=Toggle(False))
views_in_drawing = ViewsInDrawing(Drawing=active_drawing, All_objects=0)
drawing_source = DrawingSource(Drawing=active_drawing)
view_properties = ViewProperties(View=views_in_drawing)  # -> Type, Name, ViewCS, DisplayCS, RestrictionBox, Scale, Tags
deconstruct_assembly = DeconstructAssembly(Assembly=drawing_source, ToleranceMm=0.6)  # -> Name, Type, MainPart, Secondaries, AllObjects
search_using_key = SearchUsingKey(Values=views_in_drawing, Keys=view_properties.Type, Search="SectionView")
view_properties_2 = ViewProperties(View=search_using_key)  # -> Type, Name, ViewCS, DisplayCS, RestrictionBox, Scale, Tags
convert_to_brep = ConvertToBrep(TeklaObject=deconstruct_assembly.MainPart, SolidType=2, ToleranceMm=0.6)
graft_tree = GraftTree(Tree=view_properties_2.DisplayCS, IncludeEmptyLists=True, IncludeNullItems=True)
brep_projection_border = BrepProjectionBorder(Brep=convert_to_brep, Plane=graft_tree)  # -> Boundary, Hole, UnionRectangle
viewing_direction = ViewingDirection({"From Left": {1,0,0}, "From Right": {-1,0,0}, "From Bottom": {0,1,0}, "From Top": {0,-1,0}}, selected="From Bottom")
simplify_tree = SimplifyTree(Tree=brep_projection_border.UnionRectangle, Front=False)
multiplication = Multiplication(A=viewing_direction, B=Slider(194, range=0..500))
find_visible_edges = FindVisibleEdges(Curve=simplify_tree, Vector=viewing_direction)  # -> Points, Edges, Extremes
negative = Negative(Value=multiplication)
move = Move(Geometry=find_visible_edges.Edges, Motion=negative)  # -> Geometry, Transform
panel = Panel(search_using_key)
panel_2 = Panel(find_visible_edges.Extremes)
dimension_line = DimensionLine(
    View=search_using_key,
    Points=find_visible_edges.Extremes,
    Location=move.Geometry,
    Insert_always=0,
    Remove_when_input_is_empty=False)
