# Grasshopper definition QD_Purlin Geometry.ghx (Grasshopper 1.0.8)
# plug-ins: Grasshopper-Tekla Link 2021.1.21, Grasshopper-Tekla drawing Link 2.25

activedrawing = ActiveDrawing(Toggle=Toggle(True))
views = ViewsInDrawing(Drawing=activedrawing, All_objects=0)
G = ObjectsFromView(View=views, All_objects=0)  # -> DrawingObject, Keys
viewproperties = ViewProperties(View=views)  # -> Type, Name, ViewCS, DisplayCS, RestrictionBox, Scale, Tags
viewproperties_2 = ViewProperties(View=views)  # -> Type, Name, ViewCS, DisplayCS, RestrictionBox, Scale, Tags
search = SearchUsingKey(Values=G.DrawingObject, Keys=G.DrawingObject, Search="Part")
dtom = DrawingToModelObject(DrawingPart=search)
search_2 = SearchUsingKey(Values=G.DrawingObject, Keys=G.DrawingObject, Search="Bolt")
brep = ConvertToBrep(TeklaObject=dtom, SolidType=2, ToleranceMm=0.6)
dtom_2 = DrawingToModelObject(DrawingPart=search_2)
orient = SimpleOrient(Geometry=brep, Plane=viewproperties_2.ViewCS)
bprops = BoltProperties(Bolt=dtom_2)  # -> Size, Standard, Type, Positions, Direction
pt = Point(viewproperties.DisplayCS)
addition = Addition(A=pt, B=bprops.Direction)
orient_2 = Orient(Geometry=addition, Source=viewproperties.DisplayCS, Target=PlaneXY(0, 0, 0))  # -> Geometry, Transform
c_filter_bolt = CSharpScript(DrB=dtom_2, Direction=orient_2.Geometry)  # -> out, xIndex, yIndex, zIndex, skewIndex; inputs DrB: list, Direction: list of Vector3d
# ---------- c_filter_bolt: C# ----------
using System;
using System.Collections.Generic;
using Rhino.Geometry;
using Grasshopper;
using Grasshopper.Kernel;
using Grasshopper.Kernel.Data;
using Grasshopper.Kernel.Types;

public class Script_Instance : GH_ScriptInstance
{
    private void RunScript(
		List<object> DrB,
		List<Vector3d> Direction,
		ref object xIndex,
		ref object yIndex,
		ref object zIndex,
		ref object skewIndex)
    {
        // Kiểm tra nếu đầu vào không hợp lệ
        if (DrB == null || Direction == null || DrB.Count != Direction.Count) return;

        // Tạo danh sách chứa chỉ mục các phần tử
        List<int> xList = new List<int>();
        List<int> yList = new List<int>();
        List<int> zList = new List<int>();
        List<int> skewList = new List<int>();

        // Ngưỡng sai số khi kiểm tra phương (cho phép một độ lệch nhỏ)
        double tolerance = 0.01;

        for (int i = 0; i < DrB.Count; i++)
        {
            Vector3d dir = Direction[i];
            dir.Unitize(); // Chuẩn hóa vector về độ dài 1 để so sánh

            // Kiểm tra phương gần với trục nào nhất
            if (Math.Abs(dir.X) > 1 - tolerance && Math.Abs(dir.Y) < tolerance && Math.Abs(dir.Z) < tolerance)
            {
                xList.Add(i);
            }
            else if (Math.Abs(dir.Y) > 1 - tolerance && Math.Abs(dir.X) < tolerance && Math.Abs(dir.Z) < tolerance)
            {
                yList.Add(i);
            }
            else if (Math.Abs(dir.Z) > 1 - tolerance && Math.Abs(dir.X) < tolerance && Math.Abs(dir.Y) < tolerance)
            {
                zList.Add(i);
            }
            else
            {
                skewList.Add(i);
            }
        }

        // Gán đầu ra là danh sách chỉ mục
        xIndex = xList;
        yIndex = yList;
        zIndex = zList;
        skewIndex = skewList;
    }
}
# ---------- end c_filter_bolt ----------
item = ListItem(List=dtom_2, Index=c_filter_bolt.yIndex, Wrap=True)
item_2 = ListItem(List=dtom_2, Index=c_filter_bolt.xIndex, Wrap=True)
item_3 = ListItem(List=dtom_2, Index=c_filter_bolt.zIndex, Wrap=True)
item_4 = ListItem(List=dtom_2, Index=c_filter_bolt.skewIndex, Wrap=True)
bprops_2 = BoltProperties(Bolt=item_2)  # -> Size, Standard, Type, Positions, Direction
bprops_3 = BoltProperties(Bolt=item)  # -> Size, Standard, Type, Positions, Direction
bprops_4 = BoltProperties(Bolt=item_4)  # -> Size, Standard, Type, Positions, Direction
bprops_5 = BoltProperties(Bolt=item_3)  # -> Size, Standard, Type, Positions, Direction
orient_3 = SimpleOrient(Geometry=bprops_2.Positions, Plane=viewproperties.DisplayCS)
orient_4 = SimpleOrient(Geometry=bprops_3.Positions, Plane=viewproperties.DisplayCS)
orient_5 = SimpleOrient(Geometry=bprops_4.Positions, Plane=viewproperties.DisplayCS)
orient_6 = SimpleOrient(Geometry=bprops_5.Positions, Plane=viewproperties.DisplayCS)
